# Grasshopper definition Meta_test.gh (Grasshopper 1.0.7)
# plug-ins: MetaComp

length = Slider(29, range=0..100)
radius = Slider(39, range=0..100)
cyl = Cylinder(Base=PlaneXY(0, 0, 0), Radius=radius, Length=length)
meta = MetaComp(Value=Slider(39, range=0..100), InputStr="Radius")
