# Grasshopper definition NewestRhinoInsideUnity.gh (Grasshopper 1.0.7)

box_number = Slider(10, range=0..20)
angle = Slider(9.44, range=0..30)
size = Slider(2.8, range=0..4)
height = Slider(0.183, range=0..1)
multiplication = Multiplication(A=height, B=2)
rad = Radians(Degrees=angle)
box = CenterBox(Base=PlaneXY(0, 0, 0), X=size, Y=size, Z=height)
series = Series(Start=0, Step=multiplication, Count=box_number)
series_2 = Series(Start=0, Step=rad, Count=box_number)
Z = UnitZ(Factor=series)
bnd = Bounds(Numbers=series_2)
move = Move(Geometry=box, Motion=Z)  # -> Geometry, Transform
remap = RemapNumbers(Value=series_2, Source=bnd, Target=Domain(0, 1))  # -> Mapped, Clipped
rotate = Rotate(Geometry=move.Geometry, Angle=series_2, Plane=PlaneXY(0, 0, 0))  # -> flatten(Geometry), Transform
gradient = Gradient(
    LowerLimit=0,
    UpperLimit=1,
    Parameter=remap.Mapped,
    stops=[0: RGB(234, 38, 0), 0.25: RGB(234, 126, 0), 0.5: RGB(254, 244, 84), 0.75: RGB(173, 203, 249)])
preview = CustomPreview(Geometry=rotate.Geometry, Material=gradient)
