# Grasshopper definition differ_calc.gh (Grasshopper 1.0.7)
# plug-ins: gradient

segments = Slider(8, range=0..10)
radius = Slider(20, range=0..100)
width = Slider(20, range=0..100)
height = Slider(20, range=0..100)
length = Slider(20, range=0..100)
polygon = Polygon(Plane="{0,0,0}", Radius=radius, Segments=segments, FilletRadius=0)  # -> Polygon, Length
button = Button()
box = DomainBox(Base="{0,0,0}", X=width, Y=length, Z=height)
mesh = Mesh(box)
grad = GradientCalculator(Mesh=mesh, Toggle=button, Reset=Button())
c_script = CSharpScript(mesh=mesh, calc=button)  # -> out; inputs mesh: Mesh, calc: Boolean
# ---------- c_script: C# usings ----------
using Grasshopper.Plugin;
using System.Linq;
# ---------- c_script: C# ----------
    GH_RhinoScriptInterface GH = new GH_RhinoScriptInterface();
    GH_Document GHdoc = Grasshopper.Instances.ActiveCanvas.Document; //TODO Check if this has to be updated when a new document is opened


    if (!GH.IsEditorLoaded() || GHdoc == null)
    {
      RhinoApp.WriteLine("Open a grasshopper document and re-try");
      return;
    }

    List<Point3d> vertices = new List<Point3d>();
    foreach(Point3d vertex in mesh.Vertices) // import vertices
    {
      vertices.Add(vertex);
    }
    vertices = vertices.Union(vertices).ToList(); // Dedpulicate
    foreach(Point3d vertex in vertices)
    {
      Print(vertex.ToString());
    }

    List<Grasshopper.Kernel.Special.GH_NumberSlider> sliders = new List<Grasshopper.Kernel.Special.GH_NumberSlider>();
    List<string> names = new List<string>();
    List <decimal> vals = new List<decimal> ();

    foreach (var element in GHdoc.Objects)
    {
      if (element.GetType().ToString() == "Grasshopper.Kernel.Special.GH_NumberSlider") {
        var slider = element as Grasshopper.Kernel.Special.GH_NumberSlider;
        names.Add(slider.NickName);
        vals.Add(slider.CurrentValue);
      }
    }

    Print("******************");
    for(int i = 0; i < vals.Count;i++){
      updateSlider(names[i], vals[i] + 3);
    }

    // recalculate here <> - retrigger the solution, retrieve new points
    //GHdoc.ScheduleSolution(4);
    if (GHdoc != null)
      GHdoc.ScheduleSolution(10, ScheduleCallback);
    /*
    for(int i = 0;i < vertices.Count;i++){
      this.last_vert[i] = vertices[i];
    }
*/
    //
    List<Point3d> new_vert = new List<Point3d>();
    foreach(Point3d vertex in mesh.Vertices) // import vertices
    {
      new_vert.Add(vertex);
    }
    new_vert = new_vert.Union(new_vert).ToList(); // Dedpulicate
    foreach(Point3d vertex in new_vert)
    {
      Print(vertex.ToString());
    }
    for(int i = 0; i < vals.Count;i++){
      updateSlider(names[i], vals[i]);
    }

    // sliders - the original sliders and their values
    // vertices - the original vertices and their values
# ---------- c_script: C# additional code ----------
  List<Point3d> last_verts = new List<Point3d>();
  private void updateSlider(string name, decimal val){
    GH_RhinoScriptInterface GH = new GH_RhinoScriptInterface();
    GH_Document GHdoc = Grasshopper.Instances.ActiveCanvas.Document; //TODO Check if this has to be updated when a new document is opened

    foreach (var element in GHdoc.Objects)
    {
      if (element.GetType().ToString() == "Grasshopper.Kernel.Special.GH_NumberSlider") {
        var slider = element as Grasshopper.Kernel.Special.GH_NumberSlider;

        if (slider.NickName.Equals(name, StringComparison.Ordinal)) {
          slider.SetSliderValue(val);
        }
      }
    }
  }

  
  private void ScheduleCallback(GH_Document document)
  {
    this.Component.ExpireSolution(false);
  }
# ---------- end c_script ----------
panel = Panel(grad)
