# Grasshopper definition nl_bench.gh (Grasshopper 1.0.7)
# plug-ins: gradient

length = Slider(10, range=0..30)
radius = Slider(3.321, range=0..100)
factor = Slider(2, range=0..10)
ycount = Slider(4, range=0..20)
zcount = Slider(8, range=0..20)
xcount = Slider(3, range=0..20)
division = Division(A=radius, B=factor)
box = DomainBox(Base=PlaneXY(0, 0, 0), X=division, Y=length, Z=division)
msphereex = MeshSphereEx(Base=PlaneXY(0, 0, 0), Radius=radius, Count=5)
mbox = MeshBox(Base=box, XCount=xcount, YCount=ycount, ZCount=zcount)
mdif = MeshDifference(MeshesA=msphereex, MeshesB=mbox)
mesh = Mesh(mdif)
grad = GradientCalculator(Mesh=mesh, Toggle=Button(), Reset=Button())  # -> Result, Vertices
panel = Panel(grad.Vertices)
panel_2 = Panel(grad.Result)
